% Simulink data dictionary Robot_1DD.sldd

Data = Simulink.Bus()
  VideoFrames: double

LightsCmds = Simulink.Bus()
  HeadlightsCmds: double
  RearLightsCmds: double
  IndicatorsCmds: double

Motor_Ctrl = Simulink.Bus()
  LM_dir: double
  RM_dir: double
  LM_pwm: double
  RM_pwm: double

OperatorCommands = Simulink.Bus()
  RetractorCmds: double  % Open / Close the box
  PTZCmds: double  % Pan, Tilt, Zoom

Pwr = Simulink.Bus()
  Pwr40V: double
  Pwr24V: double
  Pwr12V: double
  Pwr6V: double
  PwrStatus: double
  SOC: double